# Grasshopper definition test_slider_python.ghx (Grasshopper 1.0.8)
# Minimal test

testpy = TestPython(x=Slider(5, range=0..10))  # -> port
# ---------- testpy: Python ----------
a = x
# ---------- end testpy ----------
